# Grasshopper definition 2_GH_fabrication.gh (Grasshopper 1.0.7)
# plug-ins: Human

cutthrough_crvs = Geometry([<curve referenced from the Rhino model> x18])

# ---- group: Line_Wiehgt
number_slider = Slider(0.02, range=0..0.1)

# ---- group: Boundary Curves
boundary_crvs = Geometry([<curve referenced from the Rhino model> x18])

# ---- group: Inner Curves
inner_crvs = Geometry([<curve referenced from the Rhino model> x14])

# ----
crv = Curve([boundary_crvs, inner_crvs, cutthrough_crvs])
join = JoinCurves(Curves=boundary_crvs, Preserve=False)
disc = Discontinuity(Curve=crv, Level=1)  # -> Points, Parameters
flip = FlipCurve(Curve=crv)  # -> Curve, Flag
boundary = BoundarySurfaces(Edges=join)
disc_2 = Discontinuity(Curve=join, Level=1)  # -> Points, Parameters
python = GhPythonScript(pts=flatten(disc.Points))  # -> out, circles; inputs pts: list
# ---------- python: Python ----------
__author__ = "holah"
__version__ = "2022.03.30"

import rhinoscriptsyntax as rs
import ghpythonlib.components as ghcomp

ptDict = {}
ptListSimplified = []
circles = []

for point in pts:
    point_count = pts.count(point)
    ptDict[point] = point_count
    
ptListSimplified = ptDict.keys()

for point in ptListSimplified:
    circles.append(ghcomp.Circle(point, 0.55))
# ---------- end python ----------
eval = EvaluateLength(Curve=crv, Length="0.55", Normalized=invert(True))  # -> Point, Tangent, Parameter
eval_2 = EvaluateLength(Curve=flip.Curve, Length="0.55", Normalized=invert(True))  # -> Point, Tangent, Parameter

# ---- group: Layer_Info
# Main Control Buttons
# 1. Update the layer information each time when start using this GH definition.
# 2. Toggle the bake button if you are ready for fabrication.
# 1
update = BooleanToggle(False)
layertable = LayerTable(Update=update, AutoUpdate=False)  # -> Layers, FullLayerPaths, LayerColors, Linetypes, MaterialNames, Visible, PrintWidth, PrintColor

# ----
python_2 = GhPythonScript(vertices=disc_2.Points, boundaries=boundary_crvs, crvs=crv, circles=python.circles)  # -> out, circleAtBoundary, circleAtCorner, circleAtEdge, circleInsideBoundary; inputs vertices: list, boundaries: list of Line, crvs: list of Curve, circles: list
# ---------- python_2: Python ----------
__author__ = "holah"
__version__ = "2022.04.01"

import rhinoscriptsyntax as rs
import ghpythonlib.components as ghcomp

circleAtBoundary = set()
circleAtCorner = []
centerPts = []
verticesList = []
circleAtEdge = []
circleInsideBoundary = set()
#intersectingLines = []

#print(set(circles))

for circle in circles:
    for line in boundaries:
        numberOfIntersection = ghcomp.CurveXCurve(circle, line)[0]
        if (numberOfIntersection):
            print(numberOfIntersection)
            circleAtBoundary.add(circle)
            
for circle in set(circles):
    if circle not in circleAtBoundary:
        circleInsideBoundary.add(circle)

for circle in circleAtBoundary:
    center = ghcomp.Area(circle)[1]
    if str(center) in vertices:
        circleAtCorner.append(circle)
    else:
        circleAtEdge.append(circle)
# ---------- end python_2 ----------
rigidllines = Line(StartPoint=eval.Point, EndPoint=eval_2.Point)
offset = OffsetCurve(Curve=join, Distance=expr("-x", 0.5), Corners=1)
boundary_2 = BoundarySurfaces(Edges=offset)
trim = TrimWithRegion(Curve=python_2.circleAtEdge, Region=boundary)  # -> flatten(Inside), Outside
ccx = CurveCurve(CurveA=python_2.circleAtBoundary, CurveB=join)  # -> flatten(Points), ParamsA, ParamsB
split = SplitWithBrep(Curve=rigidllines, Brep=boundary_2)  # -> flatten(InnerLines), Points

# ---- group: Baking
# 2
bake = BooleanToggle(False)

# ----
python_3 = GhPythonScript(pts=ccx.Points, cornerPts=disc_2.Points)  # -> out, lineAtCorner; inputs pts: list of Point3d, cornerPts: list of Point3d
# ---------- python_3: Python ----------
__author__ = "holah"
__version__ = "2022.04.03"

import rhinoscriptsyntax as rs
import ghpythonlib.components as ghcomp

lineAtCorner = []

for point in pts:
    for vertex in cornerPts:
        distance = ghcomp.Distance(point, vertex)
        print(distance)
        if distance <= 1.5:
            line = ghcomp.Line(point, vertex)
            print(line)
            lineAtCorner.append(line)
print(lineAtCorner)
# ---------- end python_3 ----------
python_4 = GhPythonScript(rigidLines=rigidllines, innerLines=split.InnerLines)  # -> out, lineAtBoundary; inputs rigidLines: list of Line, innerLines: list of Line
# ---------- python_4: Python ----------
__author__ = "holah"
__version__ = "2022.04.02"

import rhinoscriptsyntax as rs
import ghpythonlib.components as ghcomp

lineAtBoundary = []

for line in rigidLines:
    if line not in innerLines:
        lineAtBoundary.append(line)
        
print(lineAtBoundary)
# ---------- end python_4 ----------
offset_2 = OffsetCurve(Curve=split.InnerLines, Distance="0.1", Corners=1)
offset_3 = OffsetCurve(Curve=split.InnerLines, Distance=expr("-x", "0.1"), Corners=1)
myler = JoinCurves(Curves=[python_4.lineAtBoundary, python_3.lineAtCorner, trim.Inside], Preserve=False)
rigid_ad = Merge(Data1=rigidllines, Data2=offset_2, Data3=offset_3)
releasecut = Geometry([python_2.circleInsideBoundary, cutthrough_crvs, myler, python_2.circleAtCorner])
item = ListItem(List=layertable.Layers, Index="9", Wrap=True)
item_2 = ListItem(List=layertable.Layers, Index="10", Wrap=True)
item_3 = ListItem(List=layertable.Layers, Index="11", Wrap=True)
createatts = CreateAttributes(LayerName=item, enableFullPath=False)
createatts_2 = CreateAttributes(LayerName=item_2, enableFullPath=False)
createatts_3 = CreateAttributes(LayerName=item_3, enableFullPath=False)
bake_2 = BakeGeometry(Bake=bake, Geometry=myler, Attributes=createatts, DeleteOldBakes=False, PreserveTrees=False)
bake_3 = BakeGeometry(Bake=bake, Geometry=releasecut, Attributes=createatts_2, DeleteOldBakes=False, PreserveTrees=False)
bake_4 = BakeGeometry(Bake=bake, Geometry=rigid_ad, Attributes=createatts_3, DeleteOldBakes=False, PreserveTrees=False)
